# Dynamo graph 00_numberSlider_master.dyn (Dynamo 1.0.1.1167)

number_slider = DoubleSlider(5.536, range=0..10 step 0.001)
create_sequence = CodeBlock(x=number_slider) { 0..#8..x; }
watch = Watch(create_sequence)
integer_slider = DoubleSlider(7, range=0..10 step 1)
code_block = CodeBlock(x=integer_slider) { x+5; }
watch_2 = Watch(code_block)
number_slider_2 = DoubleSlider(18.9, range=0..100 step 0.1)
watch_3 = Watch(number_slider_2)
number_slider_3 = DoubleSlider(6.011, range=0..10 step 0.001)
integer_slider_2 = DoubleSlider(5, range=0..10 step 1)
create_interpolated_range = CodeBlock(x=number_slider_3, y=integer_slider_2) { 0..x..#y; }
watch_4 = Watch(create_interpolated_range)
