# Dynamo graph 00_Point_master.dyn (Dynamo 1.0.1.1167)

number_slider = DoubleSlider(10.9, range=0..100 step 0.1)
number_slider_2 = DoubleSlider(9.8, range=0..100 step 0.1)
byCoordinates = Point.ByCoordinates(x=number_slider, y=number_slider_2, lacing=CrossProduct)
grid_bounds_xy = DoubleSlider(50, range=0..100 step 1)
grid_spacing = DoubleSlider(2, range=1..5 step 0.1)
code_block = CodeBlock(a=grid_bounds_xy, b=grid_spacing) { 0..a..b; }
byCoordinates_2 = Point.ByCoordinates(x=code_block, y=code_block, lacing=CrossProduct)
code_block_2 = CodeBlock { 1; 5; 1; }
byCoordinates_3 = Point.ByCoordinates(x=code_block_2.out0, y=code_block_2.out1, z=code_block_2.out2)
byOrigin = CoordinateSystem.ByOrigin(byCoordinates_3)
number_slider_3 = DoubleSlider(330, range=0..360 step 30)
number_slider_4 = DoubleSlider(120, range=0..180 step 10)
code_block_3 = CodeBlock(a=number_slider_3, b=number_slider_4) { 0..a..10; 0..b..10; }
number_slider_5 = DoubleSlider(8, range=0..10 step 1)
bySphericalCoordinates = Point.BySphericalCoordinates(byOrigin, code_block_3.out0, code_block_3.out1, number_slider_5, lacing=CrossProduct)
origin = Point.Origin()
byOrigin_2 = CoordinateSystem.ByOrigin(origin)
number_slider_6 = DoubleSlider(300, range=0..360 step 30)
number_slider_7 = DoubleSlider(9.1, range=0..10 step 0.1)
code_block_4 = CodeBlock(a=number_slider_6, b=number_slider_7) { 0..a..10; 0..b..1; }
number_slider_8 = DoubleSlider(3, range=0..10 step 1)
byCylindricalCoordinates = Point.ByCylindricalCoordinates(byOrigin_2, code_block_4.out0, code_block_4.out1, number_slider_8, lacing=CrossProduct)
origin_2 = Point.Origin()
XAxis = Vector.XAxis()
ZAxis = Vector.ZAxis()
YAxis = Vector.YAxis()
byOriginVectors = CoordinateSystem.ByOriginVectors(origin=origin_2, xAxis=XAxis, yAxis=ZAxis, zAxis=YAxis)
number_slider_9 = DoubleSlider(8, range=0..10 step 1)
number_slider_10 = DoubleSlider(7, range=1..10 step 1)
number_slider_11 = DoubleSlider(9, range=0..10 step 1)
code_block_5 = CodeBlock(a=number_slider_9, b=number_slider_10, c=number_slider_11) { 0..a..1; 0..10..#b; 0..c..1; }
byCartesianCoordinates = Point.ByCartesianCoordinates(byOriginVectors, code_block_5.out0, code_block_5.out1, code_block_5.out2, lacing=CrossProduct)
