# Dynamo graph 00_Circle_master.dyn (Dynamo 1.0.1.1167)

integer_slider = IntegerSlider(6, range=3..20 step 1)
randomList = Math.RandomList(integer_slider)
code_block = CodeBlock(x=randomList) { x*20; }
randomList_2 = Math.RandomList(integer_slider)
code_block_2 = CodeBlock(y=randomList_2) { y*20; }
byCoordinates = Point.ByCoordinates(x=code_block, y=code_block_2)
byBestFitThroughPoints = Circle.ByBestFitThroughPoints(byCoordinates)
number = DoubleInput(3)
randomList_3 = Math.RandomList(number)
code_block_3 = CodeBlock(x=randomList_3) { x*20; }
randomList_4 = Math.RandomList(number)
code_block_4 = CodeBlock(x=randomList_4) { x*20; }
byCoordinates_2 = Point.ByCoordinates(x=code_block_3, y=code_block_4)
deconstruct = List.Deconstruct(list=byCoordinates_2)
deconstruct_2 = List.Deconstruct(list=deconstruct.rest)
byThreePoints = Circle.ByThreePoints(deconstruct.first, deconstruct_2.first, deconstruct_2.rest)
code_block_5 = CodeBlock { 1; 3; 3; }
byCoordinates_3 = Point.ByCoordinates(x=code_block_5.out0, y=code_block_5.out1, z=code_block_5.out2)
number_slider = DoubleSlider(5, range=0..10 step 0.1)
origin = Point.Origin()
byTwoPoints = Vector.ByTwoPoints(start=byCoordinates_3, end=origin)
byCenterPointRadiusNormal = Circle.ByCenterPointRadiusNormal(byCoordinates_3, number_slider, byTwoPoints)
YZ = Plane.YZ()
number_slider_2 = DoubleSlider(4, range=0..10 step 0.1)
byPlaneRadius = Circle.ByPlaneRadius(plane=YZ, radius=number_slider_2)
code_block_6 = CodeBlock { 1; 2; 0; }
byCoordinates_4 = Point.ByCoordinates(x=code_block_6.out0, y=code_block_6.out1, z=code_block_6.out2)
number_slider_3 = DoubleSlider(7.1, range=0..100 step 0.1)
byCenterPointRadius = Circle.ByCenterPointRadius(centerPoint=byCoordinates_4, radius=number_slider_3)
