# Dynamo graph 00_RegularPolygon_master.dyn (Dynamo 1.0.1.1167)

number_slider = DoubleSlider(7, range=3..10 step 1)
randomList = Math.RandomList(number_slider)
randomList_2 = Math.RandomList(number_slider)
byCoordinates = Point.ByCoordinates(x=randomList, y=randomList_2)
byBestFitThroughPoints = Circle.ByBestFitThroughPoints(byCoordinates)
regularPolygon = Polygon.RegularPolygon(circle=byBestFitThroughPoints, numberSides=number_slider)
