# Dynamo graph 00_Rectangle_master.dyn (Dynamo 1.0.1.1167)

number_slider = DoubleSlider(9, range=1..10 step 0.1)
number_slider_2 = DoubleSlider(8.2, range=1..10 step 0.1)
byWidthLength = Rectangle.ByWidthLength(width=number_slider, length=number_slider_2)
number_slider_3 = DoubleSlider(1.8, range=1..10 step 0.1)
number_slider_4 = DoubleSlider(7.7, range=1..10 step 0.1)
code_block = CodeBlock(x=number_slider_3, y=number_slider_4) { x; y; }
byCoordinates = Point.ByCoordinates(x=code_block.y, y=code_block.y)
byCoordinates_2 = Point.ByCoordinates(x=code_block.y, y=code_block.x)
byCoordinates_3 = Point.ByCoordinates(x=code_block.x, y=code_block.x)
byCoordinates_4 = Point.ByCoordinates(x=code_block.x, y=code_block.y)
byCornerPoints = Rectangle.ByCornerPoints(byCoordinates, byCoordinates_2, byCoordinates_3, byCoordinates_4)
join = List.Join(byCoordinates, byCoordinates_2, byCoordinates_3, byCoordinates_4)
byCornerPoints_2 = Rectangle.ByCornerPoints(join)
origin = Point.Origin()
number_slider_5 = DoubleSlider(0.8, range=0..1 step 0.1)
number_slider_6 = DoubleSlider(0.5, range=0..1 step 0.1)
code_block_2 = CodeBlock(a=number_slider_5, b=number_slider_6) { Autodesk.DesignScript.Geometry.Vector.ByCoordinates(a,b,0); Autodesk.DesignScript.Geometry.Vector.ByCoordinates(0,1,0); }
byOriginVectors = CoordinateSystem.ByOriginVectors(origin=origin, xAxis=code_block_2.out0, yAxis=code_block_2.out1)
number_slider_7 = DoubleSlider(8, range=0..100 step 0.1)
number_slider_8 = DoubleSlider(12.3, range=0..100 step 0.1)
byWidthLength_2 = Rectangle.ByWidthLength(cs=byOriginVectors, width=number_slider_7, length=number_slider_8)
