# Dynamo graph 00_Polycurve_master.dyn (Dynamo 1.0.1.1167)

code_block = CodeBlock { 1; 3; }
byCoordinates = Point.ByCoordinates(x=code_block.out0, y=code_block.out1)
number = DoubleInput(5)
byCenterPointRadius = Circle.ByCenterPointRadius(centerPoint=byCoordinates, radius=number)
regularPolygon = Polygon.RegularPolygon(circle=byCenterPointRadius, numberSides=number)
explode = Geometry.Explode(regularPolygon)
byJoinedCurves = PolyCurve.ByJoinedCurves(explode)
code_block_2 = CodeBlock { 1; 3; }
byCoordinates_2 = Point.ByCoordinates(x=code_block_2.out0, y=code_block_2.out1)
number_2 = DoubleInput(5)
byCenterPointRadius_2 = Circle.ByCenterPointRadius(centerPoint=byCoordinates_2, radius=number_2)
integer_slider = IntegerSlider(9, range=3..15 step 1)
code_block_3 = CodeBlock(a=integer_slider) { 0..1..#a; }
pointAtParameter = Curve.PointAtParameter(curve=byCenterPointRadius_2, param=code_block_3)
boolean = BoolSelector(false)
byPoints = PolyCurve.ByPoints(points=pointAtParameter, connectLastToFirst=boolean)
code_block_4 = CodeBlock { 6; }
randomList = Math.RandomList(code_block_4)
code_block_5 = CodeBlock(x=randomList) { x*10; }
sort = List.Sort(code_block_5)
randomList_2 = Math.RandomList(code_block_4)
code_block_6 = CodeBlock(x=randomList_2) { x*10; }
sort_2 = List.Sort(code_block_6)
byCoordinates_3 = Point.ByCoordinates(x=sort, y=sort_2)
byControlPoints = NurbsCurve.ByControlPoints(byCoordinates_3)
number_slider = DoubleSlider(0.7, range=0..1 step 0.1)
firstItem = List.FirstItem(byCoordinates_3)
lastItem = List.LastItem(byCoordinates_3)
byTwoPoints = Vector.ByTwoPoints(start=firstItem, end=lastItem)
byThickeningCurve = PolyCurve.ByThickeningCurve(curve=byControlPoints, thickness=number_slider, nor=byTwoPoints)
