# Dynamo graph 00_nurbsCurve_master.dyn (Dynamo 1.0.1.1167)

code_block = CodeBlock { 6; }
randomList = Math.RandomList(code_block)
code_block_2 = CodeBlock(x=randomList) { x*15; }
sort = List.Sort(code_block_2)
randomList_2 = Math.RandomList(code_block)
code_block_3 = CodeBlock(x=randomList_2) { x*15; }
sort_2 = List.Sort(code_block_3)
byCoordinates = Point.ByCoordinates(x=sort, y=sort_2)
code_block_4 = CodeBlock { 3; }
boolean = BoolSelector(false)
byControlPoints = NurbsCurve.ByControlPoints(byCoordinates, code_block_4, boolean)
code_block_5 = CodeBlock { 4; }
randomList_3 = Math.RandomList(code_block_5)
sort_3 = List.Sort(randomList_3)
randomList_4 = Math.RandomList(code_block_5)
sort_4 = List.Sort(randomList_4)
byCoordinates_2 = Point.ByCoordinates(x=sort_3, y=sort_4)
count = List.Count(byCoordinates_2)
code_block_6 = CodeBlock(x=count) { x+1; }
code_block_7 = CodeBlock { 3; }
byControlPointsWeightsKnots = NurbsCurve.ByControlPointsWeightsKnots(byCoordinates_2, code_block_6, arg3=code_block_7)
code_block_8 = CodeBlock { 10; }
randomList_5 = Math.RandomList(code_block_8)
code_block_9 = CodeBlock(x=randomList_5) { x*20; }
sort_5 = List.Sort(code_block_9)
randomList_6 = Math.RandomList(code_block_8)
code_block_10 = CodeBlock(x=randomList_6) { x*20; }
sort_6 = List.Sort(code_block_10)
byCoordinates_3 = Point.ByCoordinates(x=sort_5, y=sort_6)
byPoints = NurbsCurve.ByPoints(byCoordinates_3)
code_block_11 = CodeBlock { 6; }
randomList_7 = Math.RandomList(code_block_11)
code_block_12 = CodeBlock(x=randomList_7) { x*20; }
sort_7 = List.Sort(code_block_12)
randomList_8 = Math.RandomList(code_block_11)
code_block_13 = CodeBlock(x=randomList_8) { x*20; }
sort_8 = List.Sort(code_block_13)
byCoordinates_4 = Point.ByCoordinates(x=sort_7, y=sort_8)
code_block_14 = CodeBlock { 3; }
byControlPoints_2 = NurbsCurve.ByControlPoints(byCoordinates_4, code_block_14)
code_block_15 = CodeBlock { {0,10,20,32}; {0,10,20,45}; }
byCoordinates_5 = Point.ByCoordinates(x=code_block_15.out0, y=code_block_15.out1)
byControlPoints_3 = NurbsCurve.ByControlPoints(byCoordinates_5)
code_block_16 = CodeBlock { 10; }
byCenterPointRadius = Circle.ByCenterPointRadius(radius=code_block_16)
code_block_17 = CodeBlock { 0..0.5..#5; }
pointAtParameter = Curve.PointAtParameter(curve=byCenterPointRadius, param=code_block_17)
code_block_18 = CodeBlock { -5; 0; 0; }
byCoordinates_6 = Vector.ByCoordinates(x=code_block_18.out0, y=code_block_18.out1, z=code_block_18.out2)
byPointsTangents = NurbsCurve.ByPointsTangents(pointAtParameter, byCoordinates_6, byCoordinates_6)
code_block_19 = CodeBlock { 6; }
randomList_9 = Math.RandomList(code_block_19)
code_block_20 = CodeBlock(x=randomList_9) { x*20; }
sort_9 = List.Sort(code_block_20)
randomList_10 = Math.RandomList(code_block_19)
code_block_21 = CodeBlock(x=randomList_10) { x*20; }
sort_10 = List.Sort(code_block_21)
byCoordinates_7 = Point.ByCoordinates(x=sort_9, y=sort_10)
code_block_22 = CodeBlock { 3; }
byPoints_2 = NurbsCurve.ByPoints(byCoordinates_7, code_block_22)
code_block_23 = CodeBlock { 4; }
randomList_11 = Math.RandomList(code_block_23)
code_block_24 = CodeBlock(x=randomList_11) { x*50; }
sort_11 = List.Sort(code_block_24)
randomList_12 = Math.RandomList(code_block_23)
code_block_25 = CodeBlock(x=randomList_12) { x*30; }
sort_12 = List.Sort(code_block_25)
byCoordinates_8 = Point.ByCoordinates(x=sort_11, y=sort_12)
boolean_2 = BoolSelector(true)
byPoints_3 = NurbsCurve.ByPoints(byCoordinates_8, boolean_2)
