# Dynamo graph 00_nurbsSurface.dyn (Dynamo 1.0.1.1167)

code_block = CodeBlock { 0..25..#50; }
byCoordinates = Point.ByCoordinates(x=code_block, y=code_block, lacing=CrossProduct)
ZAxis = Vector.ZAxis()
count = Count(byCoordinates)
randomList = Math.RandomList(count)
scale = Vector.Scale(vector=ZAxis, scale_factor=randomList)
translate = Geometry.Translate(geometry=byCoordinates, direction=scale)
code_block_2 = CodeBlock { 3; 3; }
byPoints = NurbsSurface.ByPoints(translate, code_block_2.out0, code_block_2.out1)
byControlPointsWeightsKnots = NurbsSurface.ByControlPointsWeightsKnots()
byPointsTangentsKnotsDerivatives = NurbsSurface.ByPointsTangentsKnotsDerivatives()
byPointsTangents = NurbsSurface.ByPointsTangents()
code_block_3 = CodeBlock { 0..25..#10; }
byCoordinates_2 = Point.ByCoordinates(x=code_block_3, y=code_block_3, lacing=CrossProduct)
ZAxis_2 = Vector.ZAxis()
count_2 = Count(byCoordinates_2)
randomList_2 = Math.RandomList(count_2)
code_block_4 = CodeBlock(x=randomList_2) { x*3; }
scale_2 = Vector.Scale(vector=ZAxis_2, scale_factor=code_block_4)
translate_2 = Geometry.Translate(geometry=byCoordinates_2, direction=scale_2)
code_block_5 = CodeBlock { 3; 3; }
byControlPoints = NurbsSurface.ByControlPoints(controlVertices=translate_2, uDegree=code_block_5.out0, vDegree=code_block_5.out1)
