# Dynamo graph ByPointAndString - Ex 1.dyn (Dynamo 0.9.1.3272)

# group: Problem
# note: Create a progression of nested sin waves and add them together

# group: Create a Progression of Thirds
mul = _ * _
code_block = CodeBlock { 1/3; }
code_block_2 = CodeBlock { 3; }
code_block_3 = CodeBlock { 3; }
ofRepeatedItem = List.OfRepeatedItem(item=code_block_2, amount=code_block_3)
scan = ScanList(mul, code_block, ofRepeatedItem)  # "List.Scan"

# group: Jesus, I don't even know what I did here.
code_block_4 = CodeBlock { a=200; -10..20..#a; 0..720..#a; }
reverse = List.Reverse(scan)
code_block_5 = CodeBlock(a=code_block_4.out2, b=scan, c=reverse) { t=Math.Sin(a<2>*b<1>); t<1><2>*c<1>; }

# group: Sum the Y coordinates of all the sin waves
transpose = List.Transpose(code_block_5.out1)
sum = Math.Sum(transpose)
byCoordinates = Point.ByCoordinates(x=code_block_4.out1, y=sum)

byPoints = PolyCurve.ByPoints(points=byCoordinates)
code_block_6 = CodeBlock(x=code_block_4.out1, y=code_block_5.out1) { Point.ByCoordinates(x<2>,y<1><2>); }
byPoints_2 = PolyCurve.ByPoints(points=code_block_6)
code_block_7 = CodeBlock(x=code_block_4.out1, y=code_block_5.out1) { Point.ByCoordinates(x<1><1>,y<2>); }
x = Watch(code_block_4.out1)
y = Watch(code_block_5.out1)
