# Dynamo graph Do Cloud Render-Ex1.dyn (Dynamo 1.3.2.2480)

view_type = ViewTypesUi("ThreeD")
getByType = Archilab.Grimshaw.Views.View.GetByType(view_type)
export_cloud_render_data = ExportDocumentRenderData(getByType)
upload_cloud_render_data = UploadRenderData(export_cloud_render_data)
name = Element.Name(getByType)
code_block = CodeBlock { 1000; }
select_rendertype = RenderTypeDropDown("Image")
select_renderquality = RenderQualityDropDown("Draft")
byViewNameWidthHeight = Analyze.Render.CloudRenderingJob.ByViewNameWidthHeight(name, code_block, code_block, select_rendertype, select_renderquality)
boolean = BoolSelector(false)
do_cloud_render = CloudRender(upload_cloud_render_data, byViewNameWidthHeight, boolean)
