# Dynamo graph AllFalse.dyn (Dynamo 1.2.0.2690)

boolean = BoolSelector(false)
boolean_2 = BoolSelector(true)
create = List.Create(boolean, boolean_2)
watch = Watch(create)
allFalse = AllFalse(watch)
watch_2 = Watch(allFalse)
create_2 = List.Create(boolean, boolean)
watch_3 = Watch(create_2)
allFalse_2 = AllFalse(watch_3)
watch_4 = Watch(allFalse_2)
create_3 = List.Create(create, create_2)
watch_5 = Watch(create_3)
allFalse_3 = AllFalse(watch_5)
watch_6 = Watch(allFalse_3)
allFalse_4 = AllFalse(watch_5@L2)
watch_7 = Watch(allFalse_4)
