# Dynamo graph Contains-Ex1.dyn "List.Contains" (Dynamo 2.0.1.5055)

code_block = CodeBlock { 1..4; }
code_block_2 = CodeBlock { 4; }
cycle = List.Cycle(list=code_block, amount=code_block_2)
shuffle = List.Shuffle(list=cycle)
code_block_3 = CodeBlock { 4; }
contains = List.Contains(list=shuffle@L1, item=code_block_3)
contains_2 = List.Contains(list=shuffle, item=code_block_3)
code_block_4 = CodeBlock { 0; }
contains_3 = List.Contains(list=shuffle, item=code_block_4)
