# Dynamo graph Count.dyn (Dynamo 1.2.0.2690)

code_block = CodeBlock { 1..5..1; }
count = Count(code_block)
watch = Watch(count)
code_block_2 = CodeBlock { 1..3..1; }
create = List.Create(code_block, code_block_2)
count_2 = Count(create, lacing=Longest)
watch_2 = Watch(count_2)
count_3 = Count(create@L2)
watch_3 = Watch(count_3)
