# Dynamo graph Equals-Ex2.dyn "==" (Dynamo 2.0.1.5055)

code_block = CodeBlock { 1..4; }
code_block_2 = CodeBlock { 4; }
cycle = List.Cycle(list=code_block, amount=code_block_2)
shuffle = List.Shuffle(list=cycle)
code_block_3 = CodeBlock { 4; }
eq = shuffle == code_block_3
