# Dynamo graph DiagonalLeft-Ex2.dyn "Diagonal Left" (Dynamo 2.0.1.5055)

code_block = CodeBlock { 0..10; }
byCoordinates = Point.ByCoordinates(x=code_block, y=code_block, lacing=CrossProduct)
code_block_2 = CodeBlock { 11; }
diagonalLeft = List.DiagonalLeft(list=byCoordinates, rowLength=code_block_2)
count = List.Count(list=diagonalLeft)
code_block_3 = CodeBlock(x=count) { 0.01..0.5..#x; }
byCenterPointRadius = Circle.ByCenterPointRadius(centerPoint=diagonalLeft, radius=code_block_3)
