# Dynamo graph DropEveryNthItem-Ex2.dyn "DropEveryNthItem" (Dynamo 2.0.1.5055)

code_block = CodeBlock { 0..5; }
byCoordinates = Point.ByCoordinates(x=code_block, y=code_block, lacing=CrossProduct)
code_block_2 = CodeBlock { 3; }
dropEveryNthItem = List.DropEveryNthItem(list=byCoordinates, n=code_block_2)
code_block_3 = CodeBlock { 0.5; }
byCenterPointRadius = Circle.ByCenterPointRadius(centerPoint=dropEveryNthItem, radius=code_block_3)
