# Dynamo graph DropItems-Ex2.dyn "DropItems" (Dynamo 2.0.1.5055)

code_block = CodeBlock { 0..5; }
byCoordinates = Point.ByCoordinates(x=code_block, y=code_block, lacing=CrossProduct)
code_block_2 = CodeBlock { 3; }
dropItems = List.DropItems(list=byCoordinates, amount=code_block_2)
code_block_3 = CodeBlock { 0.5; }
byCenterPointRadius = Circle.ByCenterPointRadius(centerPoint=dropItems, radius=code_block_3)
