# Dynamo graph ReplaceByCondition-Ex2.dyn (Dynamo 1.3.2.2480)

code_block = CodeBlock { {1,"",3,"",5,"",7}; }
code_block_2 = CodeBlock { {"",2,"",4,"",6,""}; }
code_block_3 = CodeBlock { ""; }
eq = _ == code_block_3  # unwired: arg0
replaceByCondition = Replace(code_block, code_block_2, eq)
