# Dynamo graph IF_Conditional.dyn (Dynamo 1.2.1.3083)

boolean = BoolSelector(false)
code_block = CodeBlock { 5..1; {"x","y","z"}; }
if_ = If(test=boolean, true=code_block.out0, false=code_block.out1)
watch = Watch(if_)
formula = Formula("if(test,a,b)", test=boolean, a=code_block.out0, b=code_block.out1)
watch_2 = Watch(formula)
code_block_2 = CodeBlock { test=false; a=1..2; b=5..1; test?a:b; }
watch_3 = Watch(code_block_2.out3)
formula_2 = Formula("if(test,a,b)", test=boolean, a=code_block.out0, b=code_block.out1, lacing=Longest)
watch_4 = Watch(formula_2)
code_block_3 = CodeBlock { {true,false,false,false,true}; }
code_block_4 = CodeBlock { 5..1; {"x","y","z"}; }
if_2 = If(test=code_block_3, true=code_block_4.out0, false=code_block_4.out1)
watch_5 = Watch(if_2)
formula_3 = Formula("if(test,a,b)", test=code_block_3, a=code_block_4.out0, b=code_block_4.out1)
watch_6 = Watch(formula_3)
formula_4 = Formula("if(test,a,b)", test=code_block_3, a=code_block_4.out0, b=code_block_4.out1, lacing=Longest)
watch_7 = Watch(formula_4)
