# Dynamo graph Not.dyn (Dynamo 1.2.0.2690)

boolean = BoolSelector(false)
code_block = CodeBlock(input=boolean) { !input; }
watch = Watch(code_block)
not_ = Not(boolean)
watch_2 = Watch(not_)
boolean_2 = BoolSelector(true)
not_2 = Not(boolean_2)
watch_3 = Watch(not_2)
code_block_2 = CodeBlock(input=boolean_2) { !input; }
watch_4 = Watch(code_block_2)
