# Dynamo graph CreateProjectParameter-Ex1.dyn "Adding Project Parameter" (Dynamo 2.0.1.5055)

code_block = CodeBlock { "Builber"; "General"; }
select_parameter_type = ParameterType(index=124)
select_builtin_parameter_group = BuiltInParameterGroup(index=52)
boolean = BoolSelector(true)
categories = Categories(index=589)
join = List.Join(list0=categories)
createProjectParameter = Parameter.CreateProjectParameter(parameterName=code_block.out0, groupName=code_block.out1, type=select_parameter_type, group=select_builtin_parameter_group, instance=boolean, categoryList=join)
